# Grasshopper definition Data managment input-output.gh (Grasshopper 1.0.7)
# plug-ins: Human

number_slider = Slider(45, range=0..100)  # disabled
number_slider_2 = Slider(34, range=0..100)  # disabled
number_slider_3 = Slider(38, range=0..100)  # disabled
number_slider_4 = Slider(0, range=0..100)  # disabled
number_slider_5 = Slider(42, range=0..100)  # disabled
number_slider_6 = Slider(0, range=0..100)  # disabled
number_slider_7 = Slider(0, range=0..20)  # disabled
number_slider_8 = Slider(0, range=0..100)  # disabled
pt = ConstructPoint(XCoordinate=number_slider, YCoordinate=number_slider_2, ZCoordinate=0)  # disabled
pt_2 = ConstructPoint(XCoordinate=number_slider_3, YCoordinate=number_slider_4, ZCoordinate=0)  # disabled
# Circle
pt_3 = ConstructPoint(XCoordinate=number_slider_7, YCoordinate=number_slider_5, ZCoordinate=0)  # disabled
pt_4 = ConstructPoint(XCoordinate=number_slider_8, YCoordinate=number_slider_6, ZCoordinate=0)  # disabled
toggle = BooleanToggle(True)  # disabled
intcrv = Interpolate(Vertices=[pt_3, pt, pt_2, pt_4], Degree=3, Periodic=toggle, KnotStyle=1)  # -> Curve, Length, Domain; disabled

number_slider_9 = Slider(91, range=0..100)  # disabled
number_slider_10 = Slider(107, range=0..200)  # disabled
number_slider_11 = Slider(116, range=0..200)  # disabled
number_slider_12 = Slider(31, range=0..100)  # disabled
number_slider_13 = Slider(28, range=0..100)  # disabled
number_slider_14 = Slider(9, range=0..20)  # disabled
number_slider_15 = Slider(107, range=0..200)  # disabled
number_slider_16 = Slider(-19, range=-20..200)  # disabled
number_slider_17 = Slider(-15, range=-20..200)  # disabled
number_slider_18 = Slider(51, range=-20..200)  # disabled
pt_5 = ConstructPoint(XCoordinate=number_slider_9, YCoordinate=number_slider_10, ZCoordinate=0)  # disabled
pt_6 = ConstructPoint(XCoordinate=number_slider_11, YCoordinate=number_slider_12, ZCoordinate=0)  # disabled
# Polygon
pt_7 = ConstructPoint(XCoordinate=number_slider_14, YCoordinate=number_slider_15, ZCoordinate=0)  # disabled
pt_8 = ConstructPoint(XCoordinate=number_slider_17, YCoordinate=number_slider_13, ZCoordinate=0)  # disabled
pt_9 = ConstructPoint(XCoordinate=number_slider_18, YCoordinate=number_slider_16, ZCoordinate=0)  # disabled
toggle_2 = BooleanToggle(True)  # disabled
pline = PolyLine(Vertices=[pt_7, pt_5, pt_6, pt_9, pt_8], Closed=toggle_2)  # disabled

number_slider_19 = Slider(100, range=0..100)  # disabled
number_slider_20 = Slider(100, range=0..100)  # disabled
number_slider_21 = Slider(100, range=0..100)  # disabled
number_slider_22 = Slider(0, range=0..100)  # disabled
number_slider_23 = Slider(100, range=0..100)  # disabled
number_slider_24 = Slider(0, range=0..100)  # disabled
number_slider_25 = Slider(0, range=0..20)  # disabled
number_slider_26 = Slider(0, range=0..100)  # disabled
pt_10 = ConstructPoint(XCoordinate=number_slider_19, YCoordinate=number_slider_20, ZCoordinate=0)  # disabled
pt_11 = ConstructPoint(XCoordinate=number_slider_21, YCoordinate=number_slider_22, ZCoordinate=0)  # disabled
# Rectangle
pt_12 = ConstructPoint(XCoordinate=number_slider_25, YCoordinate=number_slider_23, ZCoordinate=0)  # disabled
pt_13 = ConstructPoint(XCoordinate=number_slider_26, YCoordinate=number_slider_24, ZCoordinate=0)  # disabled
toggle_3 = BooleanToggle(True)  # disabled
pline_2 = PolyLine(Vertices=[pt_12, pt_10, pt_11, pt_13], Closed=toggle_3)  # disabled

get_geometry = GetGeometry(intcrv.Curve, AtLeast=1, AtMost=1, DeleteInput=False, Filter=1074004029, TreeAccess=False)  # disabled

length = GetNumber(Slider(40, range=0..100), AtLeast=1, AtMost=1, Maximum=1.797693135e+308, Minimum=-1.797693135e+308, TreeAccess=False)
width = GetNumber(Slider(40, range=0..100), AtLeast=1, AtMost=1, Maximum=1.797693135e+308, Minimum=-1.797693135e+308, TreeAccess=False)
rectangle = Rectangle(Plane=PlaneXY(0, 0, 0), XSize=width, YSize=length, Radius=0)  # -> Rectangle, Length

list = ValueList({"Concrate": 68, "Wood": 40, "Steel": 9}, selected="Concrate")
material_type = GetString(list, AtLeast=1, AtMost=1, TreeAccess=False)
materials = CreateModifyMaterials(Name=material_type, Diffuse=RGB(148, 75, 75), Specular=RGB(130, 127, 127), Emission=RGB(189, 185, 185))
panel = Panel(materials)

# ----
# 2D Array of Curves
hight_of_floors = Slider(5, range=0..10)
count_of_floors = Slider(22, range=1..200)
Z = UnitZ(Factor=hight_of_floors)

count_of_floors_2 = GetInteger(count_of_floors, AtLeast=1, AtMost=1, Maximum=2147483647, Minimum=-2147483648, TreeAccess=False)

arrlinear = LinearArray(Geometry=rectangle.Rectangle, Direction=Z, Count=count_of_floors_2)  # -> Geometry, Transform

loft = Loft(
    Curves=arrlinear.Geometry,
    Options={Adjust=False, Closed=False, LoftEnds=0, LoftSimp=0, LoftType=0, Rebuild=10, Refit=0.01})
preview = CustomPreview(
    Geometry=loft,
    Material={diffuse=RGB(105, 105, 105), emission=RGB(0, 0, 0), shine=0, specular=RGB(255, 255, 255), transparency=0})

number_slider_27 = Slider(20, range=0..30)  # disabled
number_slider_28 = Slider(9, range=0..10)  # disabled
number_slider_29 = Slider(4, range=0..10)  # disabled
divide = DivideCurve(Curve=arrlinear.Geometry, Count=number_slider_27, Kinks=False)  # -> Points, Tangents, Parameters; disabled
# Windows
polygon = Polygon(Plane=divide.Points, Radius=number_slider_28, Segments=number_slider_29, FilletRadius=0)  # -> Polygon, Length; disabled
flip = FlipMatrix(Data=polygon.Polygon)  # disabled
loft_2 = Loft(Curves=flip, Options={Adjust=False, Closed=False, LoftEnds=0, LoftSimp=0, LoftType=0, Rebuild=10, Refit=0.01})  # disabled
preview_2 = CustomPreview(
    Geometry=loft_2,
    Material={diffuse=RGB(0, 0, 0), emission=RGB(0, 0, 0), shine=1, specular=RGB(255, 255, 255), transparency=1})  # disabled

number_of_windows = GetInteger(Slider(16, range=0..30), AtLeast=1, AtMost=1, Maximum=2147483647, Minimum=-2147483648, TreeAccess=False)

Z_2 = UnitZ(Factor=Slider(0.75, range=0..1))
# Floors slab
extr = Extrude(Base=arrlinear.Geometry, Direction=Z_2)
cap = CapHoles(Brep=extr)

geo = Geometry(cap)

preview_3 = CustomPreview(
    Geometry=geo,
    Material={diffuse=RGB(105, 105, 105), emission=RGB(0, 0, 0), shine=0, specular=RGB(255, 255, 255), transparency=0})

divide_2 = DivideCurve(Curve=arrlinear.Geometry, Count=number_of_windows, Kinks=False)  # -> Points, Tangents, Parameters

# ----
# Windows
rectangle_2 = Rectangle(Plane=divide_2.Points, XSize=Domain(-1, 1), YSize=Domain(-2, 2), Radius=Slider(-2, range=-2..20))  # -> Rectangle, Length

flip_2 = FlipMatrix(Data=rectangle_2.Rectangle)
loft_3 = Loft(Curves=flip_2, Options={Adjust=False, Closed=False, LoftEnds=0, LoftSimp=0, LoftType=0, Rebuild=10, Refit=0.01})
preview_4 = CustomPreview(Geometry=loft_3, Material=materials)

merge = Merge(Data1=loft, Data2=geo, Data3=loft_3)
subd = SubD(merge)
subd_2 = ContextBake(Geometry=subd)
